% Requirement links of DesignModelTest.m (R2026a)

% lines 40-44 verifies fred_catalog.slreqx#20: modelMatchesPostgresDdl
        function modelMatchesPostgresDdl(testCase)
            problems = dbdesign.check_model_against_ddl(testCase.Model, ...
                fullfile(testCase.Root, "sql", "fred_schema.sql"), "postgresql");
            testCase.verifyEmpty(problems, strjoin(problems, newline));
        end

% lines 46-50 verifies fred_catalog.slreqx#21: modelMatchesMysqlDdl
        function modelMatchesMysqlDdl(testCase)
            problems = dbdesign.check_model_against_ddl(testCase.Model, ...
                fullfile(testCase.Root, "sql", "mysql", "fred_schema.sql"), "mysql");
            testCase.verifyEmpty(problems, strjoin(problems, newline));
        end

% lines 52-55 verifies fred_catalog.slreqx#22: graphCoversRelationalModel
        function graphCoversRelationalModel(testCase)
            problems = dbdesign.check_graph_model(testCase.Graph, testCase.Model, Live = false);
            testCase.verifyEmpty(problems, strjoin(problems, newline));
        end

% lines 73-79 verifies fred_catalog.slreqx#25: schemaViewNamesEveryTable
        function schemaViewNamesEveryTable(testCase, schemaView)
            dotPath = testCase.tempDot();
            dotText = dbdesign.write_schema_dot(testCase.Model, schemaView, dotPath);
            testCase.verifyTrue(isfile(dotPath));
            testCase.verifyNamesPresent(dotText, [testCase.Model.tables.name], "table");
            testCase.verifyDotCompiles(dotPath);
        end

% lines 81-86 verifies fred_catalog.slreqx#25: fdViewNamesEveryTable
        function fdViewNamesEveryTable(testCase, fdView)
            dotPath = testCase.tempDot();
            dotText = dbdesign.write_fd_dot(testCase.Model, fdView, dotPath);
            testCase.verifyNamesPresent(dotText, [testCase.Model.tables.name], "table");
            testCase.verifyDotCompiles(dotPath);
        end

% lines 88-94 verifies fred_catalog.slreqx#25: graphViewNamesEveryLabelAndRelationship
        function graphViewNamesEveryLabelAndRelationship(testCase, graphView)
            dotPath = testCase.tempDot();
            dotText = dbdesign.write_graph_dot(testCase.Graph, testCase.Model, graphView, dotPath);
            testCase.verifyNamesPresent(dotText, [testCase.Graph.labels.name], "label");
            testCase.verifyNamesPresent(dotText, [testCase.Graph.relationships.type], "relationship");
            testCase.verifyDotCompiles(dotPath);
        end

% lines 104-130 verifies fred_catalog.slreqx#26: degreeAuditCoversEveryRelationshipItNames
        function degreeAuditCoversEveryRelationshipItNames(testCase)
            % The audit file is hand-written Cypher. Keep it tied to the model:
            % seventeen statements, one rule id each, and no relationship type
            % that the graph model does not declare.
            auditPath = fullfile(testCase.Root, "neo4j", "cypher", "fred_degree_audit.cypher");
            text = fileread(auditPath);
            statements = strtrim(split(string(text), newline + ";" + newline));
            statements = statements(strlength(statements) > 0 & ~startsWith(statements, "//") ...
                | contains(statements, "MATCH"));

            testCase.verifyEqual(numel(statements), 17, "Expected 17 audit statements.");

            ruleIds = strings(0, 1);
            for s = statements'
                testCase.verifyTrue(contains(s, "RETURN"), "Statement without RETURN: " + extractBefore(s, 60));
                tok = regexp(s, "'(A\d\d) ", "tokens", "once");
                testCase.assertNotEmpty(tok, "Statement without a rule id: " + extractBefore(s, 60));
                ruleIds(end + 1, 1) = string(tok{1}); %#ok<AGROW>
            end
            testCase.verifyEqual(ruleIds, "A" + compose("%02d", (1:17)'), "Rule ids must be A01..A17 in order.");

            used = unique(string(regexp(text, "\[:([A-Z_]+)\]", "tokens")));
            declared = [testCase.Graph.relationships.type];
            testCase.verifyEmpty(setdiff(used, declared), ...
                "Audit names relationship types the graph model does not declare: " + ...
                strjoin(setdiff(used, declared), ", "));
        end