% Requirement links of NaiveAdapterPayloadTest.m (R2026a)

% lines 29-49 verifies fred_catalog.slreqx#28: fitPayloadHasEveryUncertaintyField
        function fitPayloadHasEveryUncertaintyField(testCase)
            adapter = gdss.AnalyticalNaiveRandomWalkAdapter(struct("adapter_id", "analytical.naive_random_walk"));
            trainingData = struct("target_values", (1:10)', ...
                "target_times", datetime(2020, 1, 1) + caldays(0:9)');
            payload = adapter.fit(trainingData, struct());

            for f = testCase.UncertaintyFields
                testCase.verifyTrue(isfield(payload, f), "Missing payload field: " + f);
            end

            testCase.verifyEqual(payload.parameter_covariance_status, "NOT_AVAILABLE");
            testCase.verifyEqual(payload.parameter_standard_error_status, "NOT_AVAILABLE");
            testCase.verifyEqual(payload.parameter_covariance_reference, "");
            testCase.verifyEqual(payload.parameter_standard_error_reference, "");
            testCase.verifyEmpty(payload.parameter_covariance);
            testCase.verifyEmpty(payload.parameter_standard_error);

            % No field name may carry the splice: a nested struct where a
            % value belongs is exactly what the garbled line produced.
            testCase.verifyFalse(any(contains(fieldnames(payload), "refefitPayload")));
        end