% Requirement links of SeriesReaderSqlTest.m (R2026a)

% lines 39-45 verifies fred_catalog.slreqx#33: onlyIdentifiersReachTheStatement
        function onlyIdentifiersReachTheStatement(testCase)
            testCase.verifyError(@() fred_series_sql("UNRATE'; DROP TABLE observation; --"), ?MException);
            testCase.verifyError(@() fred_series_sql(""), ?MException);
            testCase.verifyError(@() fred_series_sql("A B"), ?MException);
            testCase.verifyWarningFree(@() fred_series_sql("CUUR0000SA0L1E"));
            testCase.verifyWarningFree(@() fred_series_sql("DGS10-DGS2"));
        end